vi "802.11 FPGA STA.gvi"   [LabVIEW Communications System Design Suite 2.0.1]
panel controls:
  "reg.host read.go rcvd 0": bool
  "reg.notify host.go rcvd 0": bool
  "reg.reset 0": bool
  "RF 0/Rx/Enable": bool
  "RF 0/Tx/Enable": bool
  "RF 1/Rx/Enable": bool
  "RF 1/Tx/Enable": bool
  "ATR State": enum{"Idle", "Rx", "Tx", "Duplex"} = "Idle"
  "Radio Control Destination": T1 = "Radio 0 Config"
  "lo lpf enable": bool
  "power enable": bool
  "mixer enable": bool
  "tx.configuration": T2 = {"power enable"=TRUE, "mixer enable"=TRUE, "gain"=0}
  "RX data source": T3 = "RF"
  "packet start sample index": u16
  "rearm packet start generator": bool
  "bypass synchronization": bool
  "reset MAC RX statistics": bool
  "noise coefficient": FXP(8.8) = 10
  "mute RX while TX active?": bool = TRUE
  "number of samples to capture": u16 = 1024
  "produce silent samples": bool
  "MPDU filter config": T7 = {"remove header"=TRUE, "block unsupported frame types"=TRUE, "block FCS errors"=TRUE, "block address mismatch"=TRUE, "block header recognize error"=TRUE}
  "power calibration offset": FXP(10.3)
  "CCA energy detect threshold": FXP(10.3) = -62
  "RF gain": FXP(10.3)
  "number of samples before trigger": u16
  "synchronization settings": T8 = {"maximal normalization threshold"=65536, "peak timing metric threshold"=0.5, "consecutive samples over threshold"=10, "valley timing metric threshold"=-0.5, "consecutive samples under threshold"=10, "autocorelation threshold"=0.5, "expected peak valley distance"=608, "maximum peak valley distance deviation"=64, "samples to shift frame start"=-32, "use static CFO?"=FALSE, "static CFO"=0}
  "trigger condition": T9 = "Immediate"
  "manual trigger": bool
  "AGC tresholds": T10
  "AGC timeout": i32 = 3500
  "enable AGC": bool
  "manual PhyTxStart.req": cluster{"TX vector": T11, "Valid": bool}
  "bypass MAC TX": bool
  "RX TX turnaround time": u32 = 24
  "reset MAC TX statistics": bool
  "suppress ACK": bool
  "ACK bandwidth": enum{"20 MHz", "40 MHz", "80 MHz"} = "20 MHz"
  "rx.reset": bool = TRUE
  "rx.output sample rate": UFXP(1.47)
  "rx.delay": FXP(0.16)
  "rx 0.frequency shift": FXP(0.48)
  "rx 0.phase": FXP(0.21)
  "rx 0.impairments": T13 = {"inline gain I"=-1, "inline gain Q"=0.999992370605, "cross gain I"=0.999992370605, "cross gain Q"=0, "pre-gain offset I"=0, "pre-gain offset Q"=-1, "post-gain offset I"=0, "post-gain offset Q"=0.999992370605}
  "rx.abort": bool
  "tx.abort": bool
  "tx.reset": bool = TRUE
  "tx.input sample rate": UFXP(1.47)
  "tx.delay": FXP(0.18)
  "tx 0.frequency shift": FXP(0.48)
  "tx 0.phase": FXP(0.21)
  "tx 0.impairments": T13 = {"inline gain I"=0.999992370605, "inline gain Q"=0.999992370605, "post-gain offset I"=0.999992370605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}
  "tx 0.gain": T14 = {"gain I"=1, "gain Q"=1}
  "rx 1.impairments": T13 = {"inline gain I"=-0.999992370605, "inline gain Q"=0.999992370605, "cross gain I"=-0.999992370605, "cross gain Q"=0, "pre-gain offset I"=-1, "pre-gain offset Q"=0, "post-gain offset I"=0, "post-gain offset Q"=0}
  "rx 1.frequency shift": FXP(0.48)
  "rx 1.phase": FXP(0.21)
  "tx 1.impairments": T13 = {"inline gain I"=0.999992370605, "inline gain Q"=0.999992370605, "post-gain offset I"=-1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}
  "tx 1.frequency shift": FXP(0.48)
  "tx 1.phase": FXP(0.21)
  "tx 1.gain": T14 = {"gain I"=1, "gain Q"=1}
  "rx 0.stream enable": bool
  "rx 1.stream enable": bool
  "tx 0.stream enable": bool
  "tx 1.stream enable": bool
  "Data clock cycles per tick (0.1us)": u16 = 20
  "Data clock cycles per OFDM symbol": u16 = 480
  "rx.rf channel": UFXP(1.0)
  "tx.rf channel": UFXP(1.0)
  "enable DC offset correction": bool = TRUE
  "data clock locked?": bool
  "format": enum{"a", "ac"} = "a"
  "channel selector": UFXP(2.0)
  "device MAC address": u8[6]
  "DC centered signal": bool = TRUE
  "daughterboard": "niUsrpRio Config v1 Host.lvlib__DB Types.gtype" = "sbx"
  "antenna configuration": "niUsrpRio Config v1 Host.lvlib__Antenna Configuration.gtype" = "TX1 RX1 transmits and RX2 receives"
  "spi address": u8 = 7
  "cpld enable": bool = TRUE
  "time to wait for decoding packet": u32
  "CW Max": u16
  "CW Min": u16
  "Fixed backoff?": bool
  "Exponential Backoff Ratio": UFXP(6.10)
  "Fixed backoff value": u16
  "Backoff: Fixed Backoff Value": "U16 Register Names Enum.gtype" = "CW Max"
  "Backoff: CW Max": "U16 Register Names Enum.gtype" = "CW Max"
  "Backoff: Exponential Backoff Ratio": "FXP 6.10 Register Names Enum.gtype" = "Default"
  "Backoff: CW Min": "U16 Register Names Enum.gtype" = "CW Max"
  "Backoff: Fixed Backoff?": "Boolean Register Names Enum.gtype" = "Default"
  "Set Backoff Done Pulse to False": bool
  "Piggyback: Piggyback Address": "MAC Address Register Names.gtype" = "Default"
  "Piggyback: Enable Piggyback": "Boolean Register Names Enum.gtype" = "Default"
  "Enable Piggyback": bool
  "Use RTR instead of Data?": bool
  "Input: chain table": u64[8]
  "Host queue length (packets)": u32
  "Queue threshold for contention": u32
  "packet size (bytes)": u32
  "reset permission to contend": bool
  "Qchain:DIFS after ACK done (manual)": bool
  "Qchain:Use manual for DIFS after ACK done?": bool
  "Qchain:DIFS in global clock ticks": u32 = 340
  "Queue threshold for withdrawal (packets)": u32
  "Use manual Qchain withdrawal?": bool
  "manual Qchain withdrawal": bool
  "Qchain:id increment": u8 = 2
  "time for starting tracking": u32
panel indicators:
  "reg.notify host.go 0": bool
  "reg.host read.data 0": cluster{"go": bool, "data": u32}
  "compensated CFO": FXP(0.48)
  "MAC RX statistics": T4
  "PhyRxStart.ind": T5
  "PhyRxEnd.ind": T6
  "T2H RX Data overflow": u16
  "T2H Constallation overflow": u16
  "T2H RX Bit Processing Output FIFO overflow": u16
  "T2H RX Power Spectrum overflow": u16
  "T2H Channel Estimation overflow": u16
  "last applied gain": UFXP(5.1)
  "RF input power at packet start": FXP(10.3)
  "signal power at packet start": FXP(10.3)
  "RF input power": FXP(10.3)
  "signal power": FXP(10.3)
  "out of range?": bool
  "MAC TX statistics": T12
  "PhyTxStart.req": cluster{"TX vector": T11, "Valid": bool}
  "PhyTxEnd.ind": cluster{"Valid": bool}
  "internal loopback FIFO overflow": u16
  "TX to RF FIFO overflow": u16
  "T2H TX Baseband FIFO overflow": u16
  "T2H TX Bit Processing Output FIFO overflow": u16
  "rx.samples processed": u32
  "rx.number of IQ data overflows": u64
  "rx.number of overflows": u32
  "tx.samples processed": u32
  "tx.underflows": u32
  "tx.number of IQ data overflows": u64
  "rx.dsp reset done": bool
  "tx.dsp reset done": bool
  "tx.state": "Stream Control State.gtype"
  "rx.state": "Stream Control State.gtype"
  "Timestamp": u32
  "DC average": CFXP(1.17)
  "CW and Backoff Indicators": T15
  "Qchain:data after sifs count": u32
  "enable piggyback register": u32
  "count piggyback": u32
  "Has been transferred?": bool
  "ID table": u8[8]
  "Chain Table": u64[8]
  "Is header?": bool
  "Order in Chain": u8
  "Head Mac Address": u8[6]
  "PiggyBack Address": u8[6]
  "Check if it is matching?": bool
  "Check the ID": u8
  "Index of Max ID": i32
  "Piggy": u64
  "authorized to contend?": bool
  "FPGA queue length": u32
  "Qchain:count DIFS after ACK done": u32
  "Qchain:count TX after backoff done": u32
  "Qchain:count CCA idle for DIFS time": u32
  "Qchain:DIFS count": u32
  "Qchain:state": T16
types:
  T1 = enum{"Identification", "Board Config", "Global Config", "Radio 0 Config", "Radio 1 Config", "Synchronization", "Time", "Future Events"}
  T2 = cluster{"power enable": bool, "mixer enable": bool, "gain": u8}
  T3 = enum{"RF", "BB Data From Host", "Internal Loopback"}
  T4 = cluster{"number of frames detected": u32, "number of subframes received": u32, "number of valid subframes received": u32, "number of ACKs received": u32, "valid": bool}
  T5 = cluster{"Format": enum{"a", "ac"}, "Bandwidth": enum{"20 MHz", "40 MHz", "80 MHz"}, "PSDU Length": u32, "MCS": UFXP(4.0), "valid": bool}
  T6 = cluster{"Format Violation": bool, "Timing valid": bool, "Timing value": u32, "valid": bool}
  T7 = cluster{"remove header": bool, "block unsupported frame types": bool, "block FCS errors": bool, "block address mismatch": bool, "block header recognize error": bool}
  T8 = cluster{"maximal normalization threshold": UFXP(19.15), "peak timing metric threshold": FXP(2.6), "consecutive samples over threshold": u8, "valley timing metric threshold": FXP(2.6), "consecutive samples under threshold": u8, "autocorelation threshold": UFXP(2.14), "expected peak valley distance": u16, "maximum peak valley distance deviation": u8, "samples to shift frame start": i8, "use static CFO?": bool, "static CFO": FXP(0.48)}
  T9 = enum{"Immediate", "RX Packet Start", "TX Paket Start", "CCA energy detected"}
  T10 = cluster{"AGC active threshold": FXP(10.3), "AGC threshold 1": FXP(10.3), "AGC threshold 2": FXP(10.3), "AGC threshold 3": FXP(10.3)}
  T11 = cluster{"format": enum{"a", "ac"}, "bandwidth": enum{"20 MHz", "40 MHz", "80 MHz"}, "length": u32, "MCS": UFXP(4.0), "TX power level": UFXP(4.0), "Scrambler seed": UFXP(7.0)}
  T12 = cluster{"number of TX after SIFS requests detected": u32, "number of TX after SIFS requests completed": u32, "number of TX after backoff requests detected": u32, "number of TX after backoff requests completed": u32}
  T13 = cluster{"inline gain I": FXP(1.17), "inline gain Q": FXP(1.17), "cross gain I": FXP(1.17), "cross gain Q": FXP(1.17), "pre-gain offset I": FXP(1.17), "pre-gain offset Q": FXP(1.17), "post-gain offset I": FXP(1.17), "post-gain offset Q": FXP(1.17)}
  T14 = cluster{"gain I": FXP(3.21), "gain Q": FXP(3.21)}
  "Stream Control State.gtype" = enum{"Idle", "Active"}
  "niUsrpRio Config v1 Host.lvlib__DB Types.gtype" = enum{"sbx", "cbx", "wbx", "unknown", "ubx"}
  "niUsrpRio Config v1 Host.lvlib__Antenna Configuration.gtype" = enum{"TX1 RX1 transmits and RX2 receives", "TX1 RX1 receives and RX2 is unused"}
  T15 = cluster{"CW": u16, "Last CWs": u16[30], "Last Backoffs": u16[30], "Last Random Numbers": UFXP(0.16)[30]}
  "U16 Register Names Enum.gtype" = enum{"Default", "CW Max", "CW Min", "Fixed Backoff Value", "Backoff"}
  "FXP 6.10 Register Names Enum.gtype" = enum{"Default", "Exponential Backoff Ratio"}
  "Boolean Register Names Enum.gtype" = enum{"Default", "Fixed Backoff?", "Enable Piggyback?"}
  "MAC Address Register Names.gtype" = enum{"Default", "Piggyback MAC Address"}
  T16 = enum{"\"First time into the chain\"", "\"First time to update the id table\"", "\"Update the id table again\"", "\"Withdraw from Qchain and reset Qchain ID\""}
  "Cluster Constant.gtype" = cluster{"CW Max Reg": RegisterDataType<u16>, "CW Min Reg": RegisterDataType<u16>, "Fixed Backoff Value Reg": RegisterDataType<u16>, "Backoff": RegisterDataType<u16>, "Exponential Backoff Ratio Reg": RegisterDataType<UFXP(6.10)>, "Fixed Backoff Reg": RegisterDataType<bool>, "U16 Default": RegisterDataType<u16>, "FXP <6.10> Default": RegisterDataType<UFXP(6.10)>, "Boolean Default": RegisterDataType<bool>, "Has been transferred?": RegisterDataType<bool>, "If is the header?": RegisterDataType<bool>}
  T17 = cluster{"MPDU subtype": enum{"ACK"}, "destination MAC address": u8[6], "valid": bool}
  T18 = cluster{"CCA energy detection busy": u8, "CCA signal detection busy": bool, "frame timing valid": bool, "frame timing value": u32, "frame timing use DIFS": bool}
  T19 = cluster{"5 MHz": bool, "10 MHz": bool, "20 MHz": bool, "40 MHz": bool, "80 Mhz": bool, "160 MHz": bool}
  T20 = cluster{"format": enum{"a", "ac"}, "channel selector": UFXP(2.0), "device MAC address": u8[6], "DC centered signal": bool, "supported bandwidths": T19}
  T21 = cluster{"global timestamp": RegisterDataType<u32>, "OFDM symbol pulse": RegisterDataType<bool>, "TX active": RegisterDataType<bool>, "channel state indication": RegisterDataType<T18>, "MPDU generation request": RegisterDataType<T17>, "shared properties": RegisterDataType<T20>}
  T22 = cluster{"CCA energy detection busy": u8, "CCA signal detection busy": bool}
  T23 = enum{"Idle", "Wait for second measurement", "AGC active", "Gain locked"}
  T24 = cluster{"trigger gain setting": bool, "gain": UFXP(5.1)}
  "802.11 PHY-SAP.gtype" = cluster{"PSDU (RX)": any, "PSDU (TX)": any, "CCA detection": RegisterDataType<T22>, "PhyRxStart.req": HandshakeDataType<T5>, "PhyRxEnd.ind": HandshakeDataType<T6>, "channel state indication": HandshakeDataType<T18>, "PhyTxStart.req": HandshakeDataType<cluster{"TX vector": T11, "Valid": bool}>, "PhyTxEnd.ind": HandshakeDataType<cluster{"Valid": bool}>, "PHY RX AGC state indication": HandshakeDataType<cluster{"AGC state": T23, "AGC enabled": bool}>, "PHY RX Gain change indication": HandshakeDataType<T24>}
  T25 = cluster{"RF to RX FIFO": any, "internal loopback FIFO": any, "TX to RF FIFO": any, "Gain Settings FIFO": any}
  T26 = cluster{"output sample rate": UFXP(1.47), "delay": FXP(0.16), "frequency shift": FXP(0.48), "impairments": T13, "phase": FXP(0.21)}
  T27 = cluster{"frequency shift": FXP(0.48), "impairments": T13, "phase": FXP(0.21), "input sample rate": UFXP(1.47), "gain": T14, "delay": FXP(0.18)}
diagram:
  Register Create(initial value=1024) -> (reference out=w1)
  Register Create(initial value=8) -> (reference out=w2)
  Register Create(initial value=4) -> (reference out=w3)
  Register Create(initial value=0) -> (reference out=w4)
  Register Create(initial value=0) -> (reference out=w5)
  Register Create(initial value=FALSE) -> (reference out=w6)
  Register Create(initial value=0) -> (reference out=w7)
  Register Create(initial value=0) -> (reference out=w8)
  Register Create(initial value=FALSE) -> (reference out=w9)
  Register Create(initial value=FALSE) -> (reference out=w10)
  Register Create(initial value=FALSE) -> (reference out=w11)
  Property Node(instance in="Cluster Constant.gtype" {all zero or empty}, "CW Max Reg"=w1, "CW Min Reg"=w2, "Fixed Backoff Value Reg"=w3, "Backoff"=w4, "Exponential Backoff Ratio Reg"=w5, "Fixed Backoff Reg"=w6, "U16 Default"=w7, "FXP <6.10> Default"=w8, "Boolean Default"=w9, "Has been transferred?"=w10, "If is the header?"=w11) -> (instance out=w12)
  Register Create(initial value=0) -> (reference out=w13)
  Register Create(initial value=FALSE) -> (reference out=w14)
  w15 = T17 {"MPDU subtype"="ACK", "destination MAC address"=[0, 0, 0, 0, 0, 0], "valid"=FALSE}
  Register Create(initial value=w15) -> (reference out=w16)
  Register Create(initial value=FALSE) -> (reference out=w17)
  Register Create(initial value=T18 {all zero or empty}) -> (reference out=w18)
  w19 = T20 {"format"="a", "channel selector"=0, "device MAC address"=[0, 0, 0, 0, 0, 0], "DC centered signal"=FALSE, "supported bandwidths"={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}}
  Register Create(initial value=w19) -> (reference out=w20)
  Property Node(instance in=T21 {all zero or empty}, "global timestamp"=w13, "MPDU generation request"=w16, "channel state indication"=w18, "TX active"=w17, "OFDM symbol pulse"=w14, "shared properties"=w20) -> (instance out=w21)
  FIFO Create(data type=u8 0) -> (reference out=w22)
  FIFO Create(data type=u8 0) -> (reference out=w23)
  Register Create(initial value=T22 {all zero or empty}) -> (reference out=w24)
  Handshake Create(data type=T5 {all zero or empty}) -> (reference out=w25)
  Handshake Create(data type=T6 {all zero or empty}) -> (reference out=w26)
  Handshake Create(data type=T18 {all zero or empty}) -> (reference out=w27)
  Handshake Create(data type=cluster{"TX vector": T11, "Valid": bool} {all zero or empty}) -> (reference out=w28)
  Handshake Create(data type=cluster{"Valid": bool} {all zero or empty}) -> (reference out=w29)
  w30 = cluster{"AGC state": T23, "AGC enabled": bool} {all zero or empty}
  Handshake Create(data type=w30) -> (reference out=w31)
  Handshake Create(data type=T24 {all zero or empty}) -> (reference out=w32)
  Property Node(instance in="802.11 PHY-SAP.gtype" {all zero or empty}, "PSDU (RX)"=w22, "PSDU (TX)"=w23, "CCA detection"=w24, "PhyRxStart.req"=w25, "PhyRxEnd.ind"=w26, "channel state indication"=w27, "PhyTxStart.req"=w28, "PhyTxEnd.ind"=w29, "PHY RX AGC state indication"=w31, "PHY RX Gain change indication"=w32) -> (instance out=w33)
  clock-driven loop (clock = "802.11 AFW Resources.grsc\\MACSLOW") (after w12) forever {
    call "802.11 PHY-SAP Read MAC.gcdl"(PHY-SAP=w33) -> (CCA detection=w34, PSDU=w35, PSDU valid=w36, PhyRxStart.req=w37, PhyTxEnd.ind=w38, PhyRxEnd.ind=w39, PHY RX AGC state indication=w40, PHY RX Gain change indication=w41)
    Property Node(instance in=w21) -> ("shared properties"=w42, "global timestamp"=w43, "channel state indication"=w44)
    Register Read(reference in=w43) -> (data=w45)
    # w34: CCA detection
    call "Piggyback.gcdl"(Piggyback: Piggyback Address=$"Piggyback: Piggyback Address", Piggyback: Enable Piggyback=$"Piggyback: Enable Piggyback") -> (Piggyback Address=w46, Piggyback Enable?=w47)
    Property Node(instance in=w37) -> ("valid"=w48)
    Feedback Node(enable?=w48, initial value=u8[6] default, input=w49) -> w50
    Feedback Node(input=w51) -> w52
    Property Node(instance in="802.11 AFW Resources.grsc\\H2T TX Data") -> ("used elements"=w53)
    call "manage Qchain withdrawal.gcdl"(Host queue length (packets)=$"Host queue length (packets)", FPGA queue length (bytes)=w53, Queue threshold for withdrawal (packets)=$"Queue threshold for withdrawal (packets)", packet size (bytes)=$"packet size (bytes)", Use manual Qchain withdrawal?=$"Use manual Qchain withdrawal?", manual Qchain withdrawal=$"manual Qchain withdrawal") -> (Qchain withdrawal=w54)
    call "802.11 MAC RX.gcdl"(PSDU=w35, input valid=w36, PHY RX start indication=w37, PHY RX end indication=w39, PHY CCA timing indication=w34, reset MAC RX statistics=$"reset MAC RX statistics", device MAC address=w50, MPDU filter config=$"MPDU filter config", Enable Piggyback=w47, piggyback MAC address=w46, Qchain:DIFS after ACK done=w52, global clock counter=w45, Input: chain table=$"Input: chain table", Qchain:DIFS in global clock ticks=$"Qchain:DIFS in global clock ticks", Qchain withdrawal?=w54, Qchain:id increment=$"Qchain:id increment") -> (MAC RX statistics=w55, channel state indication=w56, ICP SDU=w57, output valid=w58, MPDU generation request=w59, ACK Received Pulse=w60, Piggyback?=w61, Qchain:count DIFS after ACK done=w62, Qchain:state=w63)
    $"Qchain:count DIFS after ACK done" <- w62
    $"Qchain:state" <- w63
    call "802.11 RX Data Sink.gcdl"(ICP SDU=w57, input valid=w58, FIFO reference="802.11 AFW Resources.grsc\\T2H RX Data") -> (FIFO overflow count=w64)
    $"T2H RX Data overflow" <- w64
    # w59: MPDU request
    Register Write(data=w56, reference in=w44) -> (reference out=w65)
    # w45: global time reference
    Register Read(reference in=w65) -> (data=w66)
    Register Read(reference in=w42) -> (data=w67)
    # w33: PHY SAP
    Property Node(instance in=w67) -> ("format"=w68, "device MAC address"=w49)
    # w65: channel state indication
    Feedback Node(input=w69) -> w70
    # w71: TX Data after SIFS
    call "802.11 Prepare ACK.gcdl"(format=w68, bandwidth=$"ACK bandwidth", MPDU generation request=w59, MAC ready=w70, suppress=$"suppress ACK") -> (MPDU block=w72, output valid=w73, TX after SIFS request=w74, TX Data After SIFS=w71)
    Register Read(reference in="802.11 AFW Resources.grsc\\Backoff") -> (data=w75)
    call "manage permission to contend.gcdl"(Host queue length (packets)=$"Host queue length (packets)", FPGA queue length (bytes)=w53, Queue threshold for contention (packets)=$"Queue threshold for contention", packet size (bytes)=$"packet size (bytes)", manual reset permission to contend=$"reset permission to contend", Qchain withdrawal pulse=w54) -> (authorized to contend?=w76)
    Feedback Node(input=w77) -> w78
    call "802.11 TX Data Source.gcdl"(ready for output=w78, H2T TX Data="802.11 AFW Resources.grsc\\H2T TX Data", bypass MAC TX=$"bypass MAC TX") -> (ICP data=w79, output valid=w80, elements available=w81)
    Feedback Node(input=w82) -> w83
    Feedback Node(input=w84) -> w85
    call "802.11 Prepare MPDU.gcdl"(ICP=w79, input valid=w80, elements available=w81, MAC ready for input=w83, TX status indication=w85, backoff value=w75, Use RTR instead of Data?=$"Use RTR instead of Data?", authorized to contend?=w76) -> (MPDU block=w86, ready for input=w77, output valid=w87, TX after backoff request=w88)
    Logical Or(w72, w86) -> w89
    Logical Or(w73, w87) -> w90
    Feedback Node(input=w91) -> w92
    call "802.11 MAC TX.gcdl"(TX after backoff request=w88, TX after SIFS request=w74, channel state indication=w66, global clock value=w45, RX TX turnaround time in global clock ticks=$"RX TX turnaround time", PSDU data ready for input=w92, PHY TX end indication=w38, MPDU block=w89, input valid=w90, reset MAC TX statistics=$"reset MAC TX statistics", Set Backoff Done Pulse to False=$"Set Backoff Done Pulse to False", TX Data After SIFS=w71, time for starting tracking=$"time for starting tracking") -> (MPDU=w93, output valid=w94, PHY TX start request=w95, TX after SIFS data ready for input=w69, TX after backoff data ready for input=w82, TX status indication=w84, MAC TX statistics=w96, TX after backoff done=w97, Qchain:data after sifs count=w98, Qchain:count TX after backoff done=w99, Qchain:DIFS done pulse=w100, Qchain:DIFS count=w101)
    call "802.11 TX MAC Bypass.gcdl"(ready for output=w92, TX data FIFO reference="802.11 AFW Resources.grsc\\H2T TX Data", bypass MAC TX=$"bypass MAC TX", manual PhyTxStart.req=$"manual PhyTxStart.req", MPDU=w93, input valid=w94, request in=w95) -> (PSDU=w102, output valid=w103, request out=w104)
    call "802.11 PHY-SAP Write MAC.gcdl"(PHY-SAP=w33, PhyTxStart.req=w104, PSDU=w102, PSDU valid=w103, channel state indication=w56) -> (PSDU TX ready for input=w91)
    $"MAC RX statistics" <- w55
    # w54: Qchain withdrawal?
    Feedback Node(input=w97) -> w105
    call "Check ACK Received.gcdl"(ACK Received Pulse In=w60, TX after backoff done=w105, time to wait for decoding packet=$"time to wait for decoding packet", global clock counter=w45) -> (ACK Received out=w106, valid?=w107)
    FIFO Write(Control Protocol Input=w107, data=w106, reference in="802.11 AFW Resources.grsc\\ACK Received FIFO")
    call "niInstr Basic Elements v1 FPGA.lvlib__Count Up U32.gcdl"(increment=w61) -> (count out=w108)
    $"count piggyback" <- w108
    $"MAC TX statistics" <- w96
    $"Qchain:DIFS count" <- w101
    $"Qchain:data after sifs count" <- w98
    $"Qchain:count TX after backoff done" <- w99
    $"FPGA queue length" <- w53
    call "niInstr Basic Elements v1 FPGA.lvlib__Count Up U32.gcdl"(increment=w47) -> (count out=w109)
    # w37: PHY RX start indication
    # w39: PHY RX end indication
    # w41: PHY RX Gain change indication
    $"enable piggyback register" <- w109
    # w40: PHY RX AGC state indication
    call "802.11 Write RX Events.gcdl"(global timestamp=w45, PHY RX start indication=w37, PHY RX end indication=w39, MAC channel state indication=w56, PHY CCA timing indication=w34, T2H FIFO reference="802.11 AFW Resources.grsc\\T2H Events", PHY RX Gain change indication=w41, PHY RX AGC state indication=w40)
    call "Track CCA Busy.gcdl"(global clock counter=w45)
    call "802.11 Capture PHY TX Indications.gcdl"(PHY TX end indication in=w38, PHY TX start request in=w104) -> (PHY TX start request out=w110, PHY TX end indication out=w111)
    $"PhyTxStart.req" <- w110
    $"authorized to contend?" <- w76
    $"PhyTxEnd.ind" <- w111
    call "802.11 Write TX Events.gcdl"(global time reference=w45, PHY TX end indication=w38, PHY TX start request=w104, TX status indication=w84, T2H FIFO reference="802.11 AFW Resources.grsc\\T2H Events")
    # w38: PhyTxEnd.ind
    call "Reset to next Chain.gcdl"(TX after backoff done=w105, slot M2 end pulse=w100, Use manual for DIFS after ACK done?=$"Qchain:Use manual for DIFS after ACK done?", global clock counter=w45, DIFS after ACK done (manual)=$"Qchain:DIFS after ACK done (manual)", Qchain:DIFS in global clock ticks=$"Qchain:DIFS in global clock ticks") -> (DIFS after ACK done=w51, count CCA idle for DIFS time=w112)
    $"Qchain:count CCA idle for DIFS time" <- w112
    call "Backoff Block.gcdl"(Backoff: CW Max=$"Backoff: CW Max", Backoff: Exponential Backoff Ratio=$"Backoff: Exponential Backoff Ratio", Backoff: CW Min=$"Backoff: CW Min", Backoff: Fixed Backoff Value=$"Backoff: Fixed Backoff Value", Backoff: Fixed Backoff?=$"Backoff: Fixed Backoff?") -> (CW and Backoff Indicators=w113)
    $"CW and Backoff Indicators" <- w113
    Register Read(reference in="802.11 AFW Resources.grsc\\Has been transferred?") -> (data=w114)
    $"Has been transferred?" <- w114
    Register Read(reference in="802.11 AFW Resources.grsc\\Piggy") -> (data=w115)
    $Piggy <- w115
    # w100: DIFS done pulse
    Register Read(reference in="802.11 AFW Resources.grsc\\Head Mac Address") -> (data=w116)
    $"Head Mac Address" <- w116
    Register Read(reference in="802.11 AFW Resources.grsc\\ID Table") -> (data=w117)
    $"ID table" <- w117
    Register Write(data=$"Input: chain table", reference in="802.11 AFW Resources.grsc\\Chain Table")
    Register Write(data=$"Fixed backoff?", reference in="802.11 AFW Resources.grsc\\Fixed Backoff?")
    Register Write(data=$"CW Max", reference in="802.11 AFW Resources.grsc\\CW Max")
    Register Write(data=$"Exponential Backoff Ratio", reference in="802.11 AFW Resources.grsc\\Exponential Backoff Ratio")
    Register Read(reference in="802.11 AFW Resources.grsc\\Piggyback Address") -> (data=w118)
    $"PiggyBack Address" <- w118
    Register Write(data=$"CW Min", reference in="802.11 AFW Resources.grsc\\CW Min")
    Register Read(reference in="802.11 AFW Resources.grsc\\Chain Table") -> (data=w119)
    $"Chain Table" <- w119
    Register Write(data=$"Enable Piggyback", reference in="802.11 AFW Resources.grsc\\Enable Piggyback?")
    Register Write(data=$"Fixed backoff value", reference in="802.11 AFW Resources.grsc\\Fixed Backoff Value")
    Register Read(reference in="802.11 AFW Resources.grsc\\Check if it is matching?") -> (data=w120)
    $"Check if it is matching?" <- w120
    Register Read(reference in="802.11 AFW Resources.grsc\\Order ID in chain") -> (data=w121)
    $"Order in Chain" <- w121
    call "check if is the header.gcdl"(Order in the Chain=w121) -> (Is header?=w122)
    $"Is header?" <- w122
    Register Read(reference in="802.11 AFW Resources.grsc\\Check the ID") -> (data=w123)
    $"Check the ID" <- w123
    Register Read(reference in="802.11 AFW Resources.grsc\\Max ID") -> (data=w124)
    $"Index of Max ID" <- w124
  }
  FIFO Create(data type=CFXP(3.13) 0+0i, depth=17) -> (reference out=w125)
  FIFO Create(data type=CFXP(3.13) 0+0i, depth=1025) -> (reference out=w126)
  FIFO Create(data type=CFXP(3.13) 0+0i, depth=1025) -> (reference out=w127)
  FIFO Create(data type=UFXP(5.1) 0, depth=17) -> (reference out=w128)
  Property Node(instance in=T25 {all zero or empty}, "RF to RX FIFO"=w125, "internal loopback FIFO"=w126, "TX to RF FIFO"=w127, "Gain Settings FIFO"=w128) -> (instance out=w129)
  clock-driven loop (clock = "802.11 AFW Resources.grsc\\PHY") forever {
    Property Node(instance in=w21) -> ("global timestamp"=w130, "shared properties"=w131, "TX active"=w132, "OFDM symbol pulse"=w133)
    Register Read(reference in=w130) -> (data=w134)
    Property Node(instance in=w129) -> ("RF to RX FIFO"=w135, "internal loopback FIFO"=w136, "TX to RF FIFO"=w137, "Gain Settings FIFO"=w138)
    Register Read(reference in=w133) -> (data=w139, reference out=w140)
    Register Read(reference in=w131) -> (data=w141)
    # w139: Symbol trigger
    Property Node(instance in=w141) -> ("supported bandwidths"=w142, "DC centered signal"=w143, "channel selector"=w144)
    Feedback Node(input=w145) -> w146
    call "802.11 PHY-SAP Read PHY.gcdl"(PHY-SAP=w33, ready for output=w146) -> (PSDU=w147, PSDU valid=w148, PhyTxStart.req=w149)
    call "niInstr Basic Elements v1 FPGA.lvlib__Detect Rising Edge.gcdl"(signal=w139) -> (edge detected=w150)
    call "802.11 PHY TX Request Handler.gcdl"(symbol trigger in=w150, PhyTxStart.req=w149, supported bandwidths=w142) -> (symbol index=w151, symbol trigger out=w152, start of packet=w153, TX vector out=w154, PhyTxEnd.ind=w155, TX active=w156)
    Register Write(data=w156, reference in=w132) -> (reference out=w157)
    call "802.11 RX Data Source.gcdl"(RX data source=$"RX data source", mute RX while TX active?=$"mute RX while TX active?", TX active register=w157, RF to RX FIFO=w135, internal loopback FIFO=w136, OFDM symbol trigger register=w140, produce silent samples=$"produce silent samples", H2T FIFO="802.11 AFW Resources.grsc\\H2T RX Baseband") -> (sample=w158, output valid=w159)
    call "802.11 Signal Filter.gcdl"(sample in=w158, input valid=w159, configuration=w141) -> (20MHz sample out=w160, output valid=w161, 40MHz sample out=w162, 80MHz sample out=w163)
    Feedback Node(input=w164) -> w165
    call "802.11 Synchronization.gcdl"(bypass synchronization=$"bypass synchronization", rearm packet start generator=$"rearm packet start generator", packet start sample index=$"packet start sample index", synchronization settings=$"synchronization settings", rearm sychronization=w165, sample in=w158, input valid=w159, filtered sample=w160, filtered sample valid=w161) -> (sample out=w166, output valid=w167, packet start=w168, compensated CFO=w169, CCA signal detected=w170)
    w171 = T20 {"format"="a", "channel selector"=0, "device MAC address"=[0, 0, 0, 0, 0, 0], "DC centered signal"=FALSE, "supported bandwidths"={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}}
    Feedback Node(enable?=w168, initial value=w171, input=w141) -> w172
    Property Node(instance in=w172) -> ("format"=w173, instance out=w174)
    Feedback Node(input=w175) -> w176
    call "802.11 RX IQ Processing.gcdl"(sample=w166, input valid=w167, packet start=w168, configuration=w176) -> (subcarrier=w177, subcarrier timing=w178, subcarrier field map=w179, last sample received=w180, channel estimate=w181, channel estimate timing=w182)
    Feedback Node(input=w183) -> w184
    call "802.11 RX Bit Processing.gcdl"(subcarrier timing=w178, subcarrier=w177, field map=w179, configuration=w184, noise coefficient=$"noise coefficient") -> (current OFDM symbol=w185, PSDU=w186, bit=w187, bit valid=w188, last byte decoded=w189, PSDU valid=w190)
    call "802.11 RX PHY State Machine.gcdl"(bit=w187, bit valid=w188, shared properties=w174, current OFDM symbol=w185, last bit of packet decoded=w189, last sample of packet received=w180, global timestamp=w134) -> (RX bit processing configuration=w183, RX IQ processing configuration=w175, PhyRxStart.ind=w191, PhyRxEnd.ind=w192)
    Property Node(instance in=w192) -> ("valid"=w164)
    Feedback Node(input=w193) -> w194
    To Fixed Point(number=w194) -> w195: FXP(10.3) Saturate:ConvergentRounding
    Select(s=$"enable AGC", t=w195, f=$"RF gain") -> w196
    call "802.11 Power Measurement.gcdl"(sample=w163, input valid=w161, CCA energy detect threshold=$"CCA energy detect threshold", power calibration offset=$"power calibration offset", RF gain=w196, sample 20MHz filtered=w160, sample 40MHz filtered=w162) -> (signal power=w197, output valid=w198, out of range?=w199, CCA energy detect=w200, RF input power=w201)
    Property Node(instance in=T22 {all zero or empty}, "CCA energy detection busy"=w200, "CCA signal detection busy"=w170) -> (instance out=w202)
    call "802.11 AGC.gcdl"(signal power=w197, packet start=w168, rearm AGC=w165, AGC thresholds=$"AGC tresholds", AGC timeout=$"AGC timeout", signal power valid=w198, enable AGC=$"enable AGC") -> (gain=w203, trigger gain setting=w204, state=w205, last applied gain=w193)
    Property Node(instance in=T24 {all zero or empty}, "trigger gain setting"=w204, "gain"=w203) -> (instance out=w206)
    w207 = cluster{"AGC state": T23, "AGC enabled": bool} {all zero or empty}
    Property Node(instance in=w207, "AGC state"=w205, "AGC enabled"=$"enable AGC") -> (instance out=w208)
    call "802.11 PHY-SAP Write PHY.gcdl"(PHY-SAP=w33, PSDU valid=w190, PSDU=w186, CCA detection=w202, PhyRxEnd.ind=w192, PhyRxStart.ind=w191, PhyTxEnd.ind=w155, PHY RX Gain change indication=w206, PHY RX AGC state indication=w208)
    call "802.11 Prepare RX IQ Data for T2H.gcdl"(subcarrier=w177, timing=w178, field map=w179, FIFO reference="802.11 AFW Resources.grsc\\T2H Constellation") -> (FIFO overflow count=w209)
    $"T2H Constallation overflow" <- w209
    call "802.11 Prepare Channel Estimation for T2H.gcdl"(channel estimate=w181, timing=w182, format=w173, FIFO reference="802.11 AFW Resources.grsc\\T2H Channel Estimation") -> (FIFO overflow count=w210)
    $"T2H Channel Estimation overflow" <- w210
    call "802.11 Trigger Capture RX Samples.gcdl"(trigger condition=$"trigger condition", manual trigger=$"manual trigger", RX packet start=w168, TX active register=w157, CCA energy detected=w200) -> (trigger=w211)
    call "802.11 Capture RX Samples.gcdl"(sample=w166, input valid=w167, trigger=w211, number of samples to capture=$"number of samples to capture", FIFO reference="802.11 AFW Resources.grsc\\T2H RX Power Spectrum", number of samples before trigger=$"number of samples before trigger") -> (FIFO overflow count=w212)
    $"T2H RX Power Spectrum overflow" <- w212
    call "802.11 TX Bit Processing.gcdl"(symbol trigger=w152, OFDM symbol index=w151, TX vector=w154, PSDU=w147, input valid=w148) -> (bit=w213, output valid=w214, ready for input=w145, modulation=w215)
    call "802.11 TX IQ Processing.gcdl"(symbol trigger=w152, OFDM symbol index=w151, TX vector=w154, channel selector=w144, start of packet=w153, bit valid=w214, bit=w213, bit processing modulation=w215, DC centered signal=w143, supported bandwidths=w142) -> (data out=w216, output valid=w217)
    call "802.11 TX Data Sink.gcdl"(TX to RF FIFO=w137, internal loopback FIFO=w136, sample=w216, input valid=w217, T2H FIFO="802.11 AFW Resources.grsc\\T2H TX Baseband") -> (T2H FIFO overflow count=w218, TX to RF FIFO overflow count=w219, internal loopback FIFO overflow count=w220)
    $"T2H TX Baseband FIFO overflow" <- w218
    $"TX to RF FIFO overflow" <- w219
    $"compensated CFO" <- w169
    $"internal loopback FIFO overflow" <- w220
    call "802.11 RX Bit Processing Data Sink.gcdl"(PSDU=w186, input valid=w190, FIFO reference="802.11 AFW Resources.grsc\\T2H RX Bit Processing Output") -> (FIFO overflow count=w221)
    $"T2H RX Bit Processing Output FIFO overflow" <- w221
    call "802.11 TX Bit Processing Data Sink.gcdl"(bit=w213, input valid=w214, modulation=w215, FIFO reference="802.11 AFW Resources.grsc\\T2H TX Bit Processing Output") -> (FIFO overflow count=w222)
    $"T2H TX Bit Processing Output FIFO overflow" <- w222
    call "802.11 Capture PHY RX Indications.gcdl"(PHY RX start indication in=w191, PHY RX end indication in=w192) -> (PHY RX start indication out=w223, PHY RX end indication out=w224)
    $"PhyRxStart.ind" <- w223
    $"PhyRxEnd.ind" <- w224
    $"RF input power" <- w201
    Feedback Node(enable?=w168, input=w201) -> w225
    $"RF input power at packet start" <- w225
    $"signal power" <- w197
    Feedback Node(enable?=w168, input=w197) -> w226
    $"signal power at packet start" <- w226
    $"out of range?" <- w199
    FIFO Write(Control Protocol Input=w204, data=w203, reference in=w138)
    $"last applied gain" <- w193
  }
  call "Create Resources.gvi"() -> (config.resources=w227, sync.resources=w228, time.resources=w229)
  clock-driven loop (clock = "40 MHz Onboard Clock") {
    Io Write(data=$"RF 1/Rx/Enable", reference in="RF 1/Rx/Enable")
    Io Write(data=$"RF 0/Tx/Enable", reference in="RF 0/Tx/Enable")
    Io Write(data=$"RF 0/Rx/Enable", reference in="RF 0/Rx/Enable")
    Feedback Node(input=w230) -> w231
    Property Node(instance in=w129) -> ("Gain Settings FIFO"=w232)
    FIFO Read(Control Protocol Input=TRUE, reference in=w232) -> (Control Protocol Output=w230, data=w233)
    Feedback Node(enable?=w230, input=w233) -> w234
    To Fixed Point(number=w234) -> w235: UFXP(6.1) Wrap:Truncate
    # Register Bus and Required Controls/Indicators
    Scale By Power Of 2(n=1, x=w235) -> w236
    To Unsigned Byte Integer(number=w236) -> w237
    Property Node(instance in=T2 {"power enable"=TRUE, "mixer enable"=TRUE, "gain"=0}, "power enable"=$"power enable", "mixer enable"=$"mixer enable", "gain"=w237) -> (instance out=w238)
    call "Set Gain.gcdl"(ATR State=$"ATR State", Radio Control Destination=$"Radio Control Destination", FPGA.Fifo="802.11 AFW Resources.grsc\\AGC Reg Bus 0 Access FIFO", daughterboard=$daughterboard, antenna configuration=$"antenna configuration", Write ATR?=w231, lo lpf enable=$"lo lpf enable", rx.configuration=w238, tx.configuration=$"tx.configuration", spi address=$"spi address", cpld enable=$"cpld enable")
    Io Write(data=$"RF 1/Tx/Enable", reference in="RF 1/Tx/Enable")
    Feedback Node(input=w239) -> w240
    Property Node(instance in=w240) -> ("ready for port 0 input"=w241, "ready for port 1 input"=w242)
    Feedback Node(input=w243) -> w244
    call "niInstr Register Bus v1 FPGA.lvlib__Process.gcdl"(reg.notify host.go rcvd=$"reg.notify host.go rcvd 0", reg.host read.go rcvd=$"reg.host read.go rcvd 0", read completion=w244, reg.reset=$"reg.reset 0", reg.host instruction fifo="niInstr Register Bus v0.grsc\\reg.host instruction fifo 0", ready for output=w242) -> (reg.notify host.go=w245, reg.host read.data=w246, register instruction=w247)
    $"reg.notify host.go 0" <- w245
    $"reg.host read.data 0" <- w246
    FIFO Read(Control Protocol Input=w241, reference in="802.11 AFW Resources.grsc\\AGC Reg Bus 0 Access FIFO") -> (Control Protocol Output=w248, data=w249)
    call "Retrieve FPGA Scoped Instruction.gcdl"(number=w249, valid=w248) -> (output cluster=w250)
    Feedback Node(input=w251) -> w252
    call "niInstr Register Bus v1 FPGA.lvlib__Register Instruction Arbiter (2 inputs).gcdl"(port 0=w250, port 1=w247, reset=FALSE, ready for output=w252) -> (register instr out=w253, ready for input=w239)
    call "Registers.gcdl"(register instruction=w253, config.resources=w227, sync.resources=w228, time.resources=w229) -> (read completion out=w243, ready for input=w251)
    stop if FALSE
  }
  clock-driven loop (clock = "Data Clock") forever {
    # Baseband to/from RF conversion
    # Data Reception from Antenna, downconversion to baseband sample rate, received data will be written into RX baseband input FIFO
    # Reading of TX baseband FIFO, upconversion and transmission to antenna
    Property Node(instance in=w21) -> ("shared properties"=w254, "global timestamp"=w255, "OFDM symbol pulse"=w256)
    call "Mod N Indexer U16 v2.gcdl"(N=$"Data clock cycles per tick (0.1us)", enable=$"data clock locked?") -> (wrap back?=w257)
    call "niInstr Basic Elements v1 FPGA.lvlib__Count Up U32.gcdl"(increment=w257, reset=FALSE) -> (count out=w258)
    Register Write(data=w258, reference in=w255)
    call "Mod N Indexer U16 v2.gcdl"(N=$"Data clock cycles per OFDM symbol", enable=$"data clock locked?") -> (wrap back?=w259)
    Register Write(data=w259, reference in=w256)
    w260 = T19 {"5 MHz"=FALSE, "10 MHz"=FALSE, "20 MHz"=TRUE, "40 MHz"=TRUE, "80 Mhz"=FALSE, "160 MHz"=FALSE}
    w261 = T20 {"format"="a", "channel selector"=0, "device MAC address"=[0, 0, 0, 0, 0, 0], "DC centered signal"=FALSE, "supported bandwidths"={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}}
    Property Node(instance in=w261, "format"=$format, "channel selector"=$"channel selector", "device MAC address"=$"device MAC address", "DC centered signal"=$"DC centered signal", "supported bandwidths"=w260) -> (instance out=w262)
    Register Write(data=w262, reference in=w254)
    $Timestamp <- w258
    Property Node(instance in=w129) -> ("TX to RF FIFO"=w263, "RF to RX FIFO"=w264)
    Build Array($"rx 0.stream enable", $"rx 1.stream enable") -> w265
    w266 = T26 {"0x800000000000", 0, 0, "0x1FFFF", "0x1FFFF", 0, 0, 0, 0, 0, 0, 0}
    Property Node(instance in=w266, "impairments"=$"rx 0.impairments", "frequency shift"=$"rx 0.frequency shift", "phase"=$"rx 0.phase", "output sample rate"=$"rx.output sample rate", "delay"=$"rx.delay") -> (instance out=w267)
    w268 = T26 {"0x800000000000", 0, 0, "0x1FFFF", "0x1FFFF", 0, 0, 0, 0, 0, 0, 0}
    Property Node(instance in=w268, "delay"=$"rx.delay", "output sample rate"=$"rx.output sample rate", "impairments"=$"rx 1.impairments", "frequency shift"=$"rx 1.frequency shift", "phase"=$"rx 1.phase") -> (instance out=w269)
    Build Array(w267, w269) -> w270
    call "802.11 USRP Stream RX.gcdl"(RF to RX FIFO reference=w264, enable DC offset correction=$"enable DC offset correction", rx.reset=$"rx.reset", rx.rf channel=$"rx.rf channel", rx. stream enabled=w265, rx.abort=$"rx.abort", DDC parameters=w270) -> (rx.number of IQ data overflows=w271, rx.dsp reset done=w272, DC average=w273, rx.state=w274, rx.samples processed=w275, rx.number of overflows=w276)
    $"rx.number of IQ data overflows" <- w271
    Build Array($"tx 0.stream enable", $"tx 1.stream enable") -> w277
    w278 = T27 {0, "0x1FFFF", "0x1FFFF", 0, 0, 0, 0, 0, 0, 0, 0, "0x200000", "0x200000", 0}
    Property Node(instance in=w278, "gain"=$"tx 0.gain", "frequency shift"=$"tx 0.frequency shift", "phase"=$"tx 0.phase", "impairments"=$"tx 0.impairments", "input sample rate"=$"tx.input sample rate", "delay"=$"tx.delay") -> (instance out=w279)
    w280 = T27 {0, "0x1FFFF", "0x1FFFF", 0, 0, 0, 0, 0, 0, 0, 0, "0x200000", "0x200000", 0}
    Property Node(instance in=w280, "delay"=$"tx.delay", "input sample rate"=$"tx.input sample rate", "gain"=$"tx 1.gain", "frequency shift"=$"tx 1.frequency shift", "phase"=$"tx 1.phase", "impairments"=$"tx 1.impairments") -> (instance out=w281)
    Build Array(w279, w281) -> w282
    call "802.11 USRP Stream TX.gcdl"(tx.enable streams=w277, tx.reset=$"tx.reset", tx.rf channel=$"tx.rf channel", TX to RF FIFO reference=w263, tx.abort=$"tx.abort", DUC parameters=w282) -> (tx.state=w283, tx.samples processed=w284, tx.underflows=w285, tx.number of IQ data overflows=w286, tx.dsp reset done=w287)
    $"tx.state" <- w283
    $"rx.dsp reset done" <- w272
    $"tx.samples processed" <- w284
    $"rx.state" <- w274
    $"tx.underflows" <- w285
    $"rx.samples processed" <- w275
    $"tx.number of IQ data overflows" <- w286
    $"rx.number of overflows" <- w276
    $"tx.dsp reset done" <- w287
    $"DC average" <- w273
  }
  call "LEDs.gvi"()
  call "niUsrpRio Config v1 FPGA.lvlib__Process.gvi"(resources=w227)
